# Grasshopper definition ABC_extinguisher.gh (Grasshopper 1.0.7)

abc_extinguisher = GhPythonScript(
    radius=Slider(1.78, range=0..10),
    height=Slider(10, range=0..10),
    nozzle_height=Slider(0.19, range=0..10),
    nozzle_radius=Slider(0.58, range=0..10),
    handle_length=Slider(5.16, range=0..10),
    handle_thickness=Slider(0.13, range=0..10),
    gauge_radius=Slider(3.92, range=0..10))  # -> out, body, handle, guage
# ---------- abc_extinguisher: Python ----------
import rhinoscriptsyntax as rs

def create_fire_extinguisher(radius, height, nozzle_height, nozzle_radius, handle_length, handle_thickness, gauge_radius):
    # list to hold the geometries
    body_parts = []
    handle_parts = []
    gauge_parts = []

    # base cylinder for the body
    body_cylinder = rs.AddCylinder([0,0,0], height, radius)
    body_parts.append(body_cylinder)
    
    # the upper part of the body as a cone
    upper_cone_height = height / 5.0
    upper_cone = rs.AddCone([0,0,height], upper_cone_height, radius)
    body_parts.append(upper_cone)
    
    # nozzle
    nozzle_cylinder = rs.AddCylinder([0,0,height + upper_cone_height], nozzle_height, nozzle_radius)
    body_parts.append(nozzle_cylinder)

    # handle - vertical part
    handle_vertical = rs.AddBox([[-handle_thickness/2, -handle_thickness/2, height + upper_cone_height - handle_length/2], 
                        [ handle_thickness/2, -handle_thickness/2, height + upper_cone_height - handle_length/2], 
                        [ handle_thickness/2,  handle_thickness/2, height + upper_cone_height - handle_length/2], 
                        [-handle_thickness/2,  handle_thickness/2, height + upper_cone_height - handle_length/2], 
                        [-handle_thickness/2, -handle_thickness/2, height + upper_cone_height + handle_length/2], 
                        [ handle_thickness/2, -handle_thickness/2, height + upper_cone_height + handle_length/2], 
                        [ handle_thickness/2,  handle_thickness/2, height + upper_cone_height + handle_length/2], 
                        [-handle_thickness/2,  handle_thickness/2, height + upper_cone_height + handle_length/2]])
    handle_parts.append(handle_vertical)
    
    # handle - horizontal part
    handle_horizontal = rs.AddBox([[-handle_length/2, -handle_thickness/2, height + upper_cone_height + handle_length/2], 
                        [ handle_length/2, -handle_thickness/2, height + upper_cone_height + handle_length/2], 
                        [ handle_length/2,  handle_thickness/2, height + upper_cone_height + handle_length/2], 
                        [-handle_length/2,  handle_thickness/2, height + upper_cone_height + handle_length/2], 
                        [-handle_length/2, -handle_thickness/2, height + upper_cone_height + handle_length/2 - handle_thickness], 
                        [ handle_length/2, -handle_thickness/2, height + upper_cone_height + handle_length/2 - handle_thickness], 
                        [ handle_length/2,  handle_thickness/2, height + upper_cone_height + handle_length/2 - handle_thickness], 
                        [-handle_length/2,  handle_thickness/2, height + upper_cone_height + handle_length/2 - handle_thickness]])
    handle_parts.append(handle_horizontal)
    
    # gauge
    gauge_cylinder = rs.AddCylinder([0, radius + gauge_radius, height/2], gauge_radius, gauge_radius/2)
    gauge_parts.append(gauge_cylinder)

    return body_parts, handle_parts, gauge_parts

# call the function with dimensions
body, handle, gauge = create_fire_extinguisher(radius, height, nozzle_height, nozzle_radius, handle_length, handle_thickness, gauge_radius)
# ---------- end abc_extinguisher ----------
abc_extinguisher_2 = GhPythonScript()  # -> out, body, handle, guage; disabled
# ---------- abc_extinguisher_2: Python ----------
import rhinoscriptsyntax as rs

def create_fire_extinguisher(radius, height, nozzle_height, nozzle_radius, handle_length, handle_thickness, gauge_radius):
    # list to hold the geometries
    body_parts = []
    handle_parts = []
    gauge_parts = []

    # base cylinder for the body
    body_cylinder = rs.AddCylinder([0,0,0], height, radius)
    body_parts.append(body_cylinder)
    
    # the upper part of the body as a cone
    upper_cone_height = height / 5.0
    upper_cone = rs.AddCone([0,0,height], upper_cone_height, radius)
    body_parts.append(upper_cone)
    
    # nozzle
    nozzle_cylinder = rs.AddCylinder([0,0,height + upper_cone_height], nozzle_height, nozzle_radius)
    body_parts.append(nozzle_cylinder)

    # handle - vertical part
    handle_vertical = rs.AddBox([[-handle_thickness/2, -handle_thickness/2, height + upper_cone_height - handle_length/2], 
                        [ handle_thickness/2, -handle_thickness/2, height + upper_cone_height - handle_length/2], 
                        [ handle_thickness/2,  handle_thickness/2, height + upper_cone_height - handle_length/2], 
                        [-handle_thickness/2,  handle_thickness/2, height + upper_cone_height - handle_length/2], 
                        [-handle_thickness/2, -handle_thickness/2, height + upper_cone_height + handle_length/2], 
                        [ handle_thickness/2, -handle_thickness/2, height + upper_cone_height + handle_length/2], 
                        [ handle_thickness/2,  handle_thickness/2, height + upper_cone_height + handle_length/2], 
                        [-handle_thickness/2,  handle_thickness/2, height + upper_cone_height + handle_length/2]])
    handle_parts.append(handle_vertical)
    
    # handle - horizontal part
    handle_horizontal = rs.AddBox([[-handle_length/2, -handle_thickness/2, height + upper_cone_height + handle_length/2], 
                        [ handle_length/2, -handle_thickness/2, height + upper_cone_height + handle_length/2], 
                        [ handle_length/2,  handle_thickness/2, height + upper_cone_height + handle_length/2], 
                        [-handle_length/2,  handle_thickness/2, height + upper_cone_height + handle_length/2], 
                        [-handle_length/2, -handle_thickness/2, height + upper_cone_height + handle_length/2 - handle_thickness], 
                        [ handle_length/2, -handle_thickness/2, height + upper_cone_height + handle_length/2 - handle_thickness], 
                        [ handle_length/2,  handle_thickness/2, height + upper_cone_height + handle_length/2 - handle_thickness], 
                        [-handle_length/2,  handle_thickness/2, height + upper_cone_height + handle_length/2 - handle_thickness]])
    handle_parts.append(handle_horizontal)
    
    # gauge
    gauge_cylinder = rs.AddCylinder([0, radius + gauge_radius, height/2], gauge_radius, gauge_radius/2)
    gauge_parts.append(gauge_cylinder)

    return body_parts, handle_parts, gauge_parts

# call the function with dimensions
body, handle, gauge = create_fire_extinguisher(1, 6, 0.5, 0.2, 1.5, 0.1, 0.5)
# ---------- end abc_extinguisher_2 ----------
# gpt-4 prompt
# Write a python script for a ghpython node in
# grasshopper for rhino3d with the rhino common
# api and the rhinoscriptsyntax api to create a
# model of an ABC extinguisher, a fire
#  extinguisher suitable for use on type
#  A, B, and C fires.
abc_extinguisher_3 = GhPythonScript()  # -> out, a; disabled
# ---------- abc_extinguisher_3: Python ----------
import rhinoscriptsyntax as rs

def create_fire_extinguisher(radius, height, nozzle_height, nozzle_radius):
    # list to hold the geometries
    geometries = []

    # base cylinder for the body
    body_cylinder = rs.AddCylinder([0,0,0], height, radius)
    geometries.append(body_cylinder)
    
    # the upper part of the body as a cone
    upper_cone_height = height / 5.0
    upper_cone = rs.AddCone([0,0,height], upper_cone_height, radius)
    geometries.append(upper_cone)
    
    # nozzle
    nozzle_cylinder = rs.AddCylinder([0,0,height + upper_cone_height], nozzle_height, nozzle_radius)
    geometries.append(nozzle_cylinder)
    
    return geometries

# call the function with dimensions
a = create_fire_extinguisher(1, 6, 0.5, 0.2)
# ---------- end abc_extinguisher_3 ----------
panel = Panel(abc_extinguisher_3.out)  # disabled
geometry = Geometry(abc_extinguisher_3.a)  # disabled
geometry_2 = Geometry(abc_extinguisher_2.body)  # disabled
geometry_3 = Geometry(abc_extinguisher_2.handle)  # disabled
geometry_4 = Geometry(abc_extinguisher_2.guage)  # disabled
geometry_5 = Geometry(abc_extinguisher.body)
geometry_6 = Geometry(abc_extinguisher.handle)
geometry_7 = Geometry(abc_extinguisher.guage)
panel_2 = Panel(abc_extinguisher_2.out)  # disabled
panel_3 = Panel(abc_extinguisher.out)
