# Grasshopper definition Abatvoix.gh (Grasshopper 1.0.7)

# gpt-4 prompt
# Write a python script for a ghpython node in
# grasshopper for rhino3d with the rhino common
# api and the rhinoscriptsyntax api to create a
# model of an abatvoix, an acoustical reflector for
#  a single voice, such as behind and over a
# church pulpit.
number_slider = Slider(8, range=0..10)
construct_point = ConstructPoint(XCoordinate=0, YCoordinate=0, ZCoordinate=0)
abatvoix = GhPythonScript(x=number_slider, y=Slider(2, range=0..10), z=construct_point, u=Slider(12, range=0..30))  # -> out, a; inputs z: Point3d, u: Int32
# ---------- abatvoix: Python ----------
import rhinoscriptsyntax as rs

def create_abatvoix(radius, height, position, degree):
    # Create a profile curve for the dome
    profile_start = (position[0], position[1], position[2] - height/2)
    profile_end = (position[0] + radius, position[1], position[2] - height/2)
    profile_curve_id = rs.AddLine(profile_start, profile_end)

    # Revolve the profile curve to create a dome
    revolution_axis = ((position[0], position[1], position[2] - height/2), (position[0], position[1], position[2] + height/2))
    dome_id = rs.AddRevSrf(profile_curve_id, revolution_axis, 0, 360)

    # create an array for panels
    panels = []

    # create panels on the dome
    for i in range(degree):
        for j in range(degree):
            pt1 = rs.SurfaceClosestPoint(dome_id, [i / float(degree), j / float(degree), 0])
            pt2 = rs.SurfaceClosestPoint(dome_id, [(i + 1) / float(degree), (j + 1) / float(degree), 0])
            pt3 = rs.SurfaceClosestPoint(dome_id, [(i + 1) / float(degree), j / float(degree), 0])
            pt4 = rs.SurfaceClosestPoint(dome_id, [i / float(degree), (j + 1) / float(degree), 0])

            if pt1 and pt2 and pt3 and pt4:
                panel_id = rs.AddSrfPt([pt1, pt2, pt3, pt4])
                panels.append(panel_id)

    # clean up temporary geometry
    rs.DeleteObject(profile_curve_id)
    rs.DeleteObject(dome_id)

    return panels

# replace with your parameters
radius = x
height = y
position = z
degree = u
abatvoix = create_abatvoix(radius, height, position, degree)

# output the panels to the ghpython component
a = abatvoix
# ---------- end abatvoix ----------
geometry = Geometry(abatvoix.a)
deconstruct_brep = DeconstructBrep(Brep=geometry)  # -> Faces, Edges, Vertices
panel = Panel(abatvoix.out)
abatvoix_2 = GhPythonScript()  # -> out, a; disabled
# ---------- abatvoix_2: Python ----------
import rhinoscriptsyntax as rs

def create_abatvoix(radius, height, position, degree):
    # Create a profile curve for the dome
    profile_start = (position[0], position[1], position[2] - height/2)
    profile_end = (position[0] + radius, position[1], position[2] - height/2)
    profile_curve_id = rs.AddLine(profile_start, profile_end)

    # Revolve the profile curve to create a dome
    revolution_axis = ((position[0], position[1], position[2] - height/2), (position[0], position[1], position[2] + height/2))
    dome_id = rs.AddRevSrf(profile_curve_id, revolution_axis, 0, 360)

    # create an array for panels
    panels = []

    # create panels on the dome
    for i in range(degree):
        for j in range(degree):
            u = i / float(degree)
            v = j / float(degree)
            pt = rs.SurfaceClosestPoint(dome_id, [u, v, 0])
            if pt:
                panel = rs.AddPoint(pt)
                panels.append(panel)

    # clean up temporary geometry
    rs.DeleteObject(profile_curve_id)
    rs.DeleteObject(dome_id)

    return panels

# replace with your parameters
radius = 5
height = 5
position = (0, 0, 0)
degree = 12
abatvoix = create_abatvoix(radius, height, position, degree)

# output the panels to the ghpython component
a = abatvoix
# ---------- end abatvoix_2 ----------
interpolate = Interpolate(Vertices=deconstruct_brep.Vertices, Degree=3, Periodic=False, KnotStyle=1)  # -> Curve, Length, Domain
geometry_2 = Geometry(abatvoix_2.a)  # disabled
panel_2 = Panel(abatvoix_2.out)  # disabled
