# Grasshopper definition Abney_level.gh (Grasshopper 1.0.7)

construct_domain = ConstructDomain(DomainStart=Slider(0.27, range=0..10), DomainEnd=Slider(2.06, range=0..10))
# gpt-4 prompt
# Write a python script for a ghpython node in
# grasshopper for rhino3d with the rhino common
# api and the rhinoscriptsyntax api to create a
# model of an Abney level, a hand-held level used
#  for measuring vertical angles.
number_slider = Slider(1.19, range=0..10)
range = Range(Domain=construct_domain, Steps="2")
abney_level = GhPythonScript(
    body_radius=number_slider,
    body_height=Slider(10, range=0..10),
    protractor_radius=Slider(2.07, range=0..10),
    protractor_height=Slider(0.3, range=0..10),
    tube_radius=Slider(0.82, range=0..10),
    bubble_level_dims=range,
    viewer_radius=Slider(0.74, range=0..10))  # -> out, a; inputs bubble_level_dims: list
# ---------- abney_level: Python ----------
import Rhino
import rhinoscriptsyntax as rs

# Inputs
# body_radius - The radius of the body of the level
# body_height - The height of the body of the level
# protractor_radius - The radius of the protractor part
# protractor_height - The height of the protractor part
# tube_radius - The radius of the sighting tube
# bubble_level_dims - The dimensions [width, height, depth] of the bubble level
# viewer_radius - The radius of the viewer

def create_cylinder(center, radius, height):
    """Creates a cylinder."""
    base_plane = rs.PlaneFromNormal(center, rs.VectorCreate([0,0,1], [0,0,0]))
    return rs.AddCylinder(base_plane, height, radius)

def create_sphere(center, radius):
    """Creates a sphere."""
    return rs.AddSphere(center, radius)

def create_box(center, width, height, depth):
    """Creates a box."""
    dx = width / 2
    dy = depth / 2
    dz = height / 2
    corners = [
        rs.AddPoint(center.X - dx, center.Y - dy, center.Z - dz),
        rs.AddPoint(center.X + dx, center.Y - dy, center.Z - dz),
        rs.AddPoint(center.X + dx, center.Y + dy, center.Z - dz),
        rs.AddPoint(center.X - dx, center.Y + dy, center.Z - dz),
        rs.AddPoint(center.X - dx, center.Y - dy, center.Z + dz),
        rs.AddPoint(center.X + dx, center.Y - dy, center.Z + dz),
        rs.AddPoint(center.X + dx, center.Y + dy, center.Z + dz),
        rs.AddPoint(center.X - dx, center.Y + dy, center.Z + dz),
    ]
    return rs.AddBox(corners)

def create_abney_level(body_radius, body_height, protractor_radius, protractor_height, tube_radius, bubble_level_dims, viewer_radius):
    """Creates a parametric model of an Abney level."""
    origin = Rhino.Geometry.Point3d(0, 0, 0)

    # Create the body of the level
    body = create_cylinder(origin, body_radius, body_height)

    # Create the rotating protractor part
    protractor_origin = Rhino.Geometry.Point3d(0, 0, body_height/2)
    protractor = create_cylinder(protractor_origin, protractor_radius, protractor_height)

    # Create the sighting tube
    sighting_tube = create_cylinder(origin, tube_radius, body_height)

    # Create the bubble level
    bubble_level_origin = Rhino.Geometry.Point3d(0, body_radius + bubble_level_dims[1]/2, body_height/2)
    bubble_level = create_box(bubble_level_origin, bubble_level_dims[0], bubble_level_dims[1], bubble_level_dims[2])

    # Create the viewer
    viewer_origin = Rhino.Geometry.Point3d(0, 0, body_height)
    viewer = create_sphere(viewer_origin, viewer_radius)

    return [body, protractor, sighting_tube, bubble_level, viewer]

# Create the Abney level
level = create_abney_level(body_radius, body_height, protractor_radius, protractor_height, tube_radius, bubble_level_dims, viewer_radius)

# Assign the level to output variable 'a'
a = level
# ---------- end abney_level ----------
abney_level_2 = GhPythonScript()  # -> out, a; disabled
# ---------- abney_level_2: Python ----------
import Rhino
import rhinoscriptsyntax as rs

def create_cylinder(center, radius, height):
    """Creates a cylinder."""
    base_plane = rs.PlaneFromNormal(center, rs.VectorCreate([0,0,1], [0,0,0]))
    return rs.AddCylinder(base_plane, height, radius)

def create_sphere(center, radius):
    """Creates a sphere."""
    return rs.AddSphere(center, radius)

def create_abney_level():
    """Creates a simplified model of an Abney level."""
    origin = Rhino.Geometry.Point3d(0, 0, 0)

    # Create the body of the level
    body = create_cylinder(origin, 1, 10)

    # Create the rotating protractor part
    protractor_origin = Rhino.Geometry.Point3d(0, 0, 5)
    protractor = create_cylinder(protractor_origin, 1.2, 0.2)

    # Create the viewer
    viewer_origin = Rhino.Geometry.Point3d(0, 0, 10)
    viewer = create_sphere(viewer_origin, 0.2)

    return [body, protractor, viewer]

# Create the Abney level
level = create_abney_level()

# Assign the level to output variable 'a'
a = level
# ---------- end abney_level_2 ----------
geometry = Geometry(abney_level_2.a)  # disabled
geometry_2 = Geometry(abney_level.a)
panel = Panel(abney_level_2.out)  # disabled
panel_2 = Panel(abney_level.out)
