# Grasshopper definition Above-grade subfloor.gh (Grasshopper 1.0.7)

number_slider = Slider(1.37, range=0..5)
# gpt-4 prompt
# Write a python script for a ghpython node in
# grasshopper for rhino3d with the rhino common
# api and the rhinoscriptsyntax api to create a
# model of an Above-grade subfloor, a floor above
# ground level, but with no headroom below.
# Output all geometries to variables a...
number_slider_2 = Slider(50, range=0..50)
above_grade_subfloor = GhPythonScript(
    length=number_slider_2,
    width=Slider(100, range=0..100),
    subfloor_thickness=number_slider,
    num_planks=Slider(8, range=0..12),
    plank_length=number_slider_2,
    plank_width=number_slider,
    space_width=Slider(10, range=0..10),
    plank_thickness=Slider(5, range=0..5))  # -> out, a; inputs num_planks: Int32
# ---------- above_grade_subfloor: Python ----------
import Rhino.Geometry as rg

# Create the supporting planks
planks = []
for i in range(num_planks):
    # Adjust the origin of the planks
    plank_origin = rg.Point3d(0, (i + 1) * space_width + i * plank_width, 0)
    plank = rg.Brep.CreateFromBox(rg.BoundingBox(plank_origin, rg.Point3d(plank_length, (i + 1) * space_width + (i + 1) * plank_width, plank_thickness)))
    planks.append(plank)

# Create the subfloor and position it on top of the planks
subfloor_origin = rg.Point3d(0, 0, plank_thickness)
subfloor = rg.Brep.CreateFromBox(rg.BoundingBox(subfloor_origin, rg.Point3d(length, width, subfloor_thickness + plank_thickness)))

# Output the geometry to variables 'a'
a = [subfloor] + planks
# ---------- end above_grade_subfloor ----------
panel = Panel(above_grade_subfloor.out)
geometry = Geometry(above_grade_subfloor.a)
