# Grasshopper definition Abrasive terrazzo.gh (Grasshopper 1.0.7)

# gpt-4 prompt
# Write a python script for a ghpython node in
# grasshopper for rhino3d with the rhino common
# api and the rhinoscriptsyntax api to create a
# model of an Abrade model, to scape or wear
# away a surface by friction or striking.
number_slider = Slider(30, range=0..100)
abrade_algorithm = GhPythonScript(num_points=number_slider)  # -> out, a, b; inputs num_points: Int32
# ---------- abrade_algorithm: Python ----------
import rhinoscriptsyntax as rs
import Rhino.Geometry as rg
import random
import math

# Generate a plane surface (replace this with your actual object)
plane = rg.Plane.WorldXY
surface = rg.PlaneSurface(plane, rg.Interval(-1, 1), rg.Interval(-1, 1))

# Create a number of random points on the surface
points = [surface.PointAt(random.random()*2-1, random.random()*2-1) for i in range(num_points)]

# Create an array to store the moved points
moved_points = []

for point in points:
    # Define the amount of movement (abrasion) 
    abrasion_amount = random.uniform(-0.1, 0.1)  # randomize abrasion level for each point
    
    # Create a vector in the direction of the z-axis scaled by the abrasion amount
    move_vec = rg.Vector3d(0, 0, abrasion_amount)
    
    # Move the point along the z-axis
    moved_point = rg.Point3d.Add(point, move_vec)
    
    # Add the moved point to the list
    moved_points.append(moved_point)

# Output the points and the moved points
a = points
b = moved_points
# ---------- end abrade_algorithm ----------
abrade_algorithm_2 = GhPythonScript(
    size=Slider(1.578, range=0..10),
    num_points=Slider(26, range=0..100),
    min_abrasion=Slider(0.08, range=0..0.08),
    max_abrasion=Slider(0, range=0..0.04))  # -> out, a, b; inputs num_points: Int32
# ---------- abrade_algorithm_2: Python ----------
import rhinoscriptsyntax as rs
import Rhino.Geometry as rg
import random
import math

# Inputs from Grasshopper:
# size - Size of the plane
# num_points - Number of points on the surface
# min_abrasion - Minimum abrasion amount
# max_abrasion - Maximum abrasion amount

# Generate a plane surface (replace this with your actual object)
plane = rg.Plane.WorldXY
surface = rg.PlaneSurface(plane, rg.Interval(-size/2, size/2), rg.Interval(-size/2, size/2))

# Create a number of random points on the surface
points = [surface.PointAt(random.uniform(-size/2, size/2), random.uniform(-size/2, size/2)) for i in range(num_points)]

# Create an array to store the moved points
moved_points = []

for point in points:
    # Define the amount of movement (abrasion) 
    abrasion_amount = random.uniform(min_abrasion, max_abrasion)  # randomize abrasion level for each point
    
    # Create a vector in the direction of the z-axis scaled by the abrasion amount
    move_vec = rg.Vector3d(0, 0, abrasion_amount)
    
    # Move the point along the z-axis
    moved_point = rg.Point3d.Add(point, move_vec)
    
    # Add the moved point to the list
    moved_points.append(moved_point)

# Output the points and the moved points
a = points
b = moved_points
# ---------- end abrade_algorithm_2 ----------
geometry = Geometry(abrade_algorithm.a)
geometry_2 = Geometry(abrade_algorithm.b)
panel = Panel(abrade_algorithm.out)
vector_2pt = Vector2Pt(PointA=geometry_2, PointB=geometry, Unitize=False)  # -> Vector, Length
deconstruct = Deconstruct(Point=geometry_2)  # -> XComponent, YComponent, ZComponent
vector_display = VectorDisplay(Anchor=geometry, Vector=vector_2pt.Vector)
sort_list = SortList(Keys=deconstruct.YComponent)  # -> Keys, ValuesValuesA
sort_list_2 = SortList(Keys=deconstruct.XComponent)  # -> Keys, ValuesValuesA
number_slider_2 = Slider(0.16, range=0..1)
construct_point = ConstructPoint(XCoordinate=sort_list_2.Keys, YCoordinate=sort_list.Keys, ZCoordinate=deconstruct.ZComponent)
negative = Negative(Value=number_slider_2)
interpolate = Interpolate(Vertices=construct_point, Degree=3, Periodic=False, KnotStyle=1)  # -> Curve, Length, Domain
pi = Pi(Factor=Slider(0.27, range=0..1))
unit_z = UnitZ(Factor=[number_slider_2, negative])
negative_2 = Negative(Value="2")
rotate_3d = Rotate3D(Geometry=interpolate.Curve, Angle=pi, Center=Point(0, 0, 0), Axis=Vector(0, 0, 1))  # -> Geometry, Transform
move = Move(Geometry=geometry, Motion=unit_z)  # -> Geometry, Transform
unit_x = UnitX(Factor=[negative_2, "2"])
extrude = Extrude(Base=rotate_3d.Geometry, Direction=unit_x)
bounding_box = BoundingBox(Content=[move.Geometry, geometry], Plane=PlaneXY(0, 0, 0), UnionBox=True)  # -> Box, Box_2
brep_join = BrepJoin(Breps=extrude)  # -> Breps, Closed
split_brep = SplitBrep(Brep=bounding_box.Box, Cutter=brep_join.Breps)
split_brep_2 = SplitBrep(Brep=brep_join.Breps, Cutter=bounding_box.Box)
dispatch = Dispatch(List=flatten(split_brep), DispatchPattern=[True, False])  # -> ListA, ListB
dispatch_2 = Dispatch(List=flatten(split_brep_2), DispatchPattern=[True, False])  # -> ListA, ListB
geometry_3 = Geometry(dispatch.ListA)
unit_z_2 = UnitZ(Factor=Slider(0.61, range=0..1))
brep_join_2 = BrepJoin(Breps=[dispatch.ListA, dispatch_2.ListB])  # -> Breps, Closed
move_2 = Move(Geometry=brep_join_2.Breps, Motion=unit_z_2)  # -> Geometry, Transform
brep_join_3 = BrepJoin(Breps=[dispatch.ListB, dispatch_2.ListB])  # -> Breps, Closed
