# Grasshopper definition Absorber plate.gh (Grasshopper 1.0.7)

# gpt-4 prompt
# Write a python script for a ghpython node in
# grasshopper for rhino3d with the rhino common
# api and the rhinoscriptsyntax api to create a
# model of an Absorbe plate with layers,
#   that part of a solar energy system that collects
#  the solar energy. Output the
#  geometries as variables a in the ghpython node.
number_slider = Slider(16.5, range=0..100)
absorber_plate = GhPythonScript(
    width=number_slider,
    height=Slider(8.1, range=0..100),
    depth=Slider(3.23, range=0..10),
    layers=Slider(3, range=0..10),
    frame_thickness=Slider(1, range=0..10))  # -> out, a, frame; inputs layers: Int32
# ---------- absorber_plate: Python ----------
import rhinoscriptsyntax as rs
import scriptcontext as sc
import Rhino.Geometry as rg
import math

def create_layered_absorber_plate(width, height, depth, layers):
    """
    Creates a layered absorber plate with specified dimensions and number of layers.
    
    Args:
    width, height, depth: Dimensions of the absorber plate
    layers: Number of layers to create
    
    Returns:
    A list of breps representing the absorber plate layers
    """
    base_plane = rs.WorldXYPlane()

    # Calculate the depth of each layer
    layer_depth = depth / layers

    # Create layers
    absorber_layers = []
    for i in range(layers):
        start = layer_depth * i
        base_rect = rg.Rectangle3d(base_plane, rg.Interval(0, width), rg.Interval(0, height)).ToNurbsCurve()
        extrusion = rg.Brep.CreateFromSurface(rg.Surface.CreateExtrusion(base_rect, rg.Vector3d(0, 0, layer_depth)))
        extrusion.Translate(0, 0, start)
        absorber_layers.append(extrusion)
    
    return absorber_layers

def create_frame(width, height, depth, frame_thickness):
    """
    Creates a frame around the absorber plate.
    
    Args:
    width, height, depth: Inner dimensions of the frame
    frame_thickness: Thickness of the frame
    
    Returns:
    A brep representing the frame
    """
    base_plane = rs.WorldXYPlane()
    outer_rect = rg.Rectangle3d(base_plane, rg.Point3d(-frame_thickness, -frame_thickness, -frame_thickness), rg.Point3d(width + frame_thickness, height + frame_thickness, depth + frame_thickness))
    inner_rect = rg.Rectangle3d(base_plane, rg.Point3d(0, 0, 0), rg.Point3d(width, height, depth))
    frame = rg.Brep.CreateFromLoft([outer_rect.ToNurbsCurve(), inner_rect.ToNurbsCurve()], rg.Point3d.Unset, rg.Point3d.Unset, rg.LoftType.Normal, False)
    return frame

# Test the function

a = create_layered_absorber_plate(width, height, depth, layers)
frame = create_frame(width, height, depth, frame_thickness)

# If you want to add the geometries to the Rhino document, uncomment the lines below
# for layer in a:
#     sc.doc.Objects.AddBrep(layer)
# if frame:
#     sc.doc.Objects.AddBrep(frame[0])
# sc.doc.Views.Redraw()
# ---------- end absorber_plate ----------
panel = Panel(absorber_plate.out)
geometry = Geometry(absorber_plate.frame)
geometry_2 = Geometry(absorber_plate.a)
cap_holes = CapHoles()
