# Grasshopper definition Abutment piece.gh (Grasshopper 1.0.7)

# gpt-4 prompt
# Write a python script for a ghpython node in
# grasshopper for rhino3d with the rhino common
# api and the rhinoscriptsyntax api to create a
# model of an Abutment piece with vertical
#  members, in structural framing,
# the horizontal member that distributes the load
# of vertical members and is thus the sole plate
# of a partition.  Output the
#  geometries as variables a in the ghpython node.
number_slider = Slider(16.5, range=0..100)
number_slider_2 = Slider(3.23, range=0..10)
number_slider_3 = Slider(3, range=0..10)
number_slider_4 = Slider(1, range=0..10)
number_slider_5 = Slider(8.1, range=0..100)
ghpython_script = GhPythonScript()  # -> Out, A
panel = Panel(ghpython_script.Out)
geometry = Geometry(ghpython_script.A)
